# Grasshopper definition Girder.gh (Grasshopper 1.0.7)

xy = XYPlane(Origin=Point(0, 0, 0))
grd_length = GetNumber(
    Slider(10000, range=3000..10000),
    AtLeast=1,
    AtMost=1,
    Maximum=1.797693135e+308,
    Minimum=-1.797693135e+308,
    TreeAccess=False)
grd_offset1 = GetNumber(Slider(1000, range=1..1000), AtLeast=1, AtMost=1, Maximum=1.797693135e+308, Minimum=-1.797693135e+308, TreeAccess=False)
grd_height = GetNumber(Slider(500, range=100..500), AtLeast=1, AtMost=1, Maximum=1.797693135e+308, Minimum=-1.797693135e+308, TreeAccess=False)
grd_width = GetNumber(
    Slider(5000, range=1000..5000),
    AtLeast=1,
    AtMost=1,
    Maximum=1.797693135e+308,
    Minimum=-1.797693135e+308,
    TreeAccess=False)
grd_offset2 = GetNumber(Slider(709, range=1..1000), AtLeast=1, AtMost=1, Maximum=1.797693135e+308, Minimum=-1.797693135e+308, TreeAccess=False)
rad = Radians(Degrees=Slider(360, range=0..360))
prot = RotatePlane(Plane=xy, Angle=rad)
box = DomainBox(Base=xy, X=grd_length, Y=grd_width, Z=grd_height)
rh_out_grd_brep = Brep(box)
debrep = DeconstructBrep(Brep=box)  # -> Faces, Edges, Vertices
integer_division = IntegerDivision(A=grd_length, B=2)
item = ListItem(List=debrep.Faces, Index="4", Wrap=True)
item_2 = ListItem(List=debrep.Faces, Index="5", Wrap=True)
pt = ConstructPoint(XCoordinate=0, YCoordinate=grd_width, ZCoordinate=0)
item_3 = ListItem(List=debrep.Vertices, Index=4, Wrap=True)
deplane = DeconstructPlane(Plane=item)  # -> Origin, XAxis, YAxis, ZAxis
subtraction = Subtraction(A=integer_division, B=grd_offset1)
area = Area(Geometry=item)  # -> Area, Centroid
move = Move(Geometry=item_3, Motion=pt)  # -> Geometry, Transform
multiplication = Multiplication(A=subtraction, B=deplane.YAxis)
neg = Negative(Value=multiplication)
move_2 = Move(Geometry=area.Centroid, Motion=multiplication)  # -> Geometry, Transform
move_3 = Move(Geometry=area.Centroid, Motion=neg)  # -> Geometry, Transform
pl_origin = PlaneOrigin(Base=item_2, Origin=move.Geometry)
pl_origin_2 = PlaneOrigin(Base=item_2, Origin=item_3)
pl_origin_3 = PlaneOrigin(Base=item, Origin=move_2.Geometry)
pl_origin_4 = PlaneOrigin(Base=item, Origin=move_3.Geometry)
pflip = FlipPlane(Plane=pl_origin_2, ReverseX=False, ReverseY=False, SwapAxes=True)
pflip_2 = FlipPlane(Plane=pl_origin, ReverseX=False, ReverseY=False, SwapAxes=True)
prot_2 = RotatePlane(Plane=pl_origin_3, Angle=-1.570796327)
prot_3 = RotatePlane(Plane=pl_origin_4, Angle=1.570796327)
rh_out_grd_sidewalk_interface1 = Plane(pflip)
rh_out_grd_sidewalk_interface2 = Plane(pflip_2)
rh_out_grd_interface2 = Plane(prot_2)
rh_out_grd_interface1 = Plane(prot_3)
deplane_2 = DeconstructPlane(Plane=rh_out_grd_sidewalk_interface2)  # -> Origin, XAxis, YAxis, ZAxis
deplane_3 = DeconstructPlane(Plane=rh_out_grd_interface2)  # -> Origin, XAxis, YAxis, ZAxis
deplane_4 = DeconstructPlane(Plane=rh_out_grd_sidewalk_interface1)  # -> Origin, XAxis, YAxis, ZAxis
deplane_5 = DeconstructPlane(Plane=rh_out_grd_interface1)  # -> Origin, XAxis, YAxis, ZAxis
vdis = VectorDisplay(Anchor=deplane_2.Origin, Vector=deplane_2.ZAxis)
vdis_2 = VectorDisplay(Anchor=deplane_4.Origin, Vector=deplane_4.ZAxis)
vdis_3 = VectorDisplay(Anchor=deplane_3.Origin, Vector=deplane_3.XAxis)
vdis_4 = VectorDisplay(Anchor=deplane_3.Origin, Vector=deplane_3.ZAxis)
vdis_5 = VectorDisplay(Anchor=deplane_5.Origin, Vector=deplane_5.ZAxis)
vdis_6 = VectorDisplay(Anchor=deplane_5.Origin, Vector=deplane_5.XAxis)
